# Grasshopper definition box.gh (Grasshopper 1.0.8)
# plug-ins: MeshEdit Components, Weaverbird

mesh = Mesh([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])
mesh_2 = Mesh([<mesh referenced from the Rhino model> x13])
mesh_3 = Mesh([<mesh referenced from the Rhino model> x41])
mjoin = MeshJoin(Meshes=mesh)
mjoin_2 = MeshJoin(Meshes=mesh_3)
mjoin_3 = MeshJoin(Meshes=mesh_2)
weldvertices = MeshWeldVertices(Mesh=mjoin, Tolerance=0.01)  # -> RuntimeMessage, Mesh
weldvertices_2 = MeshWeldVertices(Mesh=mjoin_2, Tolerance=0.01)  # -> RuntimeMessage, Mesh
weldvertices_3 = MeshWeldVertices(Mesh=mjoin_3, Tolerance=0.01)  # -> RuntimeMessage, Mesh
unifynormals = MeshUnifyNormals(Mesh=weldvertices_2.Mesh)
unifynormals_2 = MeshUnifyNormals(Mesh=weldvertices_3.Mesh)
unifynormals_3 = MeshUnifyNormals(Mesh=weldvertices.Mesh)
flip = MeshFlip(Mesh=unifynormals)
flip_2 = MeshFlip(Mesh=unifynormals_2)
flip_3 = MeshFlip(Mesh=unifynormals_3)
demesh = DeconstructMesh(Mesh=flip_3)  # -> Vertices, Faces, Colours, Normals
facen = FaceNormals(Mesh=flip_3)  # -> Centers, Normals
wbtriangles = WeaverbirdsSplitTrianglesSubdivision(MeshCurves=flip_3, Level=Slider(3, range=0..10))
wbtriangles_2 = WeaverbirdsSplitTrianglesSubdivision(MeshCurves=flip_2, Level=Slider(8, range=0..10))
wbsplitquads = WeaverbirdsConstantQuadsSplitSubdivision(MeshCurves=flip, Level=Slider(3, range=0..10), SmoothNakedEdges=0)
wbsplitquads_2 = WeaverbirdsConstantQuadsSplitSubdivision(MeshCurves=flip_2, Level=Slider(3, range=0..10), SmoothNakedEdges=0)
facen_2 = FaceNormals(Mesh=flip_2)  # -> Centers, Normals
demesh_2 = DeconstructMesh(Mesh=flip_2)  # -> Vertices, Faces, Colours, Normals
wbtriangles_3 = WeaverbirdsSplitTrianglesSubdivision(MeshCurves=flip, Level=Slider(8, range=0..10))
facen_3 = FaceNormals(Mesh=flip)  # -> Centers, Normals
demesh_3 = DeconstructMesh(Mesh=flip)  # -> Vertices, Faces, Colours, Normals
vdis = VectorDisplay(Anchor=facen.Centers, Vector=facen.Normals)
weldvertices_4 = MeshWeldVertices(Mesh=wbtriangles, Tolerance=0.01)  # -> RuntimeMessage, Mesh
weldvertices_5 = MeshWeldVertices(Mesh=wbtriangles_2, Tolerance=0.01)  # -> RuntimeMessage, Mesh
vdis_2 = VectorDisplay(Anchor=facen_2.Centers, Vector=facen_2.Normals)
weldvertices_6 = MeshWeldVertices(Mesh=wbtriangles_3, Tolerance=0.01)  # -> RuntimeMessage, Mesh
vdis_3 = VectorDisplay(Anchor=facen_3.Centers, Vector=facen_3.Normals)
mesh_4 = Mesh(weldvertices_5.Mesh)
wblaplace = WeaverbirdsLaplacianSmoothing(MeshCurves=wbsplitquads, Level=Slider(10, range=0..10), SmoothNakedEdges=0, Thin=Slider(1, range=0..10))
wblaplace_2 = WeaverbirdsLaplacianSmoothing(MeshCurves=wbsplitquads_2, Level=Slider(10, range=0..10), SmoothNakedEdges=0, Thin=Slider(1, range=0..10))
wblaplace_3 = WeaverbirdsLaplacianSmoothing(MeshCurves=weldvertices_4.Mesh, Level=1, SmoothNakedEdges=0, Thin=1)
mesh_5 = Mesh(weldvertices_6.Mesh)
tri = Triangulate(Mesh=wblaplace)  # -> Mesh, Count
tri_2 = Triangulate(Mesh=wblaplace_2)  # -> Mesh, Count
triangulate = MeshTriangulate(Mesh=wblaplace, ShortDiagonal=False)
triangulate_2 = MeshTriangulate(Mesh=wblaplace_2, ShortDiagonal=False)
mesh_6 = Mesh(triangulate_2)
mesh_7 = Mesh(triangulate)
