# Grasshopper definition results_import.gh (Grasshopper 1.0.8)
# plug-ins: RhinoCodePluginGH, MeshEdit Components

# ---- group: InputMesh
mesh = Mesh(<mesh referenced from the Rhino model>)

# ---- group: path to results.json from dtcc-solar
file_path = FilePath("/Users/jensolsson/Documents/Dev/DTCC/dtcc-solar/data/validation/box_f26_results.json")

# ----
c_script = CSharpScript(filename=file_path)  # -> out, SkyViewFactor, SunHours, DirectIrradiation, DiffuseIrradiation; inputs filename: String
# ---------- c_script: C# ----------
// Grasshopper Script Instance
#region Usings
using System;
using System.Linq;
using System.Threading.Tasks;
using System.Collections;
using System.Collections.Generic;
using System.Drawing;

using Rhino;
using Rhino.Geometry;

using Grasshopper;
using Grasshopper.Kernel;
using Grasshopper.Kernel.Data;
using Grasshopper.Kernel.Types;
using System.Text.Json;
using System.Text.Json.Serialization;

#endregion

public class Script_Instance : GH_ScriptInstance
{
    private void RunScript(
	string filename,
	ref object SkyViewFactor,
	ref object SunHours,
	ref object DirectIrradiation,
	ref object DiffuseIrradiation)
    {
        if (string.IsNullOrEmpty(filename))
        {
            return;
        }

        // Read JSON file
        string jsonText = System.IO.File.ReadAllText(filename);
        Results results = JsonSerializer.Deserialize<Results>(jsonText);

        List<double> data1 = new List<double>();
        List<double> data2 = new List<double>();
        List<double> data3 = new List<double>();
        List<double> data4 = new List<double>();

        /*
        for(int i = 0; i < results.faceMidPoints.Length; i++)
        {   
            double x = results.faceMidPoints[i][0];
            double y = results.faceMidPoints[i][1];
            double z = results.faceMidPoints[i][2];    
            facePts.Add(new Point3d(x,y,z));
        } 
        */   


        data1 = results.SkyViewFactor.ToList();
        data2 = results.SunHours.ToList();
        data3 = results.DirectIrradiation.ToList();
        data4 = results.DiffuseIrradiation.ToList();
        
        SkyViewFactor = data1;
        SunHours = data2;
        DirectIrradiation = data3;
        DiffuseIrradiation = data4;
    }

    private class Results
    {
        public double[] SkyViewFactor { get; set; }
        public double[] SunHours { get; set; }
        public double[] DirectIrradiation { get; set; }
        public double[] DiffuseIrradiation { get; set; }
    }

    public override void BeforeRunScript()
    {
    }

    public override void AfterRunScript()
    {
    }
}
# ---------- end c_script ----------
explode = MeshExplode(Mesh=mesh, Interpolate=False)
cluster = Cluster(data=c_script.SkyViewFactor)  # -> min_2, max_2, data_3
gradient = Gradient(
    LowerLimit=cluster.min_2,
    UpperLimit=cluster.max_2,
    Parameter=cluster.data_3,
    stops=[0: RGB(0, 142, 0), 0.5: RGB(254, 251, 0), 1: RGB(255, 38, 0)])
dup = DuplicateData(Data=graft(gradient), Number=Slider(3, range=0..10), Order=True)  # -> simplify(Data)
demesh = DeconstructMesh(Mesh=explode)  # -> simplify(Vertices), simplify(Faces), Colours, Normals
conmesh = ConstructMesh(Vertices=demesh.Vertices, Faces=demesh.Faces, Colours=dup)

# ==== cluster Cluster
data = ClusterInput()
data_2 = Data(data)
data_3 = ClusterOutput(data_2)
sort = SortList(Keys=data_2)  # -> Keys, ValuesA
item = ListItem(List=sort.Keys, Index=0, Wrap=True)  # -> Item1, Item
min = Data(item.Item)
min_2 = ClusterOutput(min)
max = Data(item.Item1)
max_2 = ClusterOutput(max)
